# Grasshopper definition read_citymatrix.gh (Grasshopper 0.9.76)
# plug-ins: Python Interpreter

# https://raw.githubusercontent.com/ChangingPlaces/DataTemplates/master/template.json
panel = Panel("http://cityscope.media.mit.edu/citymatrix.json")
python = PythonScript(url=panel)  # -> out, json_data, grid
# ---------- python: Python ----------
import urllib, json

response = urllib.urlopen(url)


json_data = json.loads(response.read())
print json_data

grid=json_data['grid']
# ---------- end python ----------
python_2 = PythonScript(grid=python.grid)  # -> out, texts, positions; inputs grid: list
# ---------- python_2: Python ----------
import rhinoscriptsyntax as rs

texts = []
positions = []

for e in grid:
    
    texts.append(e['type'])
    positions.append(rs.AddPoint((e['x'],e['y'],0.0)))
# ---------- end python_2 ----------
tag = TextTag3D(Location=python_2.positions, Text=python_2.texts, Size=1, Justification=7)
